# Grasshopper definition BuildingGeneration.ghx (Grasshopper 1.0.7)

bkeyxscale = Slider(0.8, range=0..1)
bkeyyscale = Slider(0.3, range=0..1)
parcelstoreyscale = Slider(0.8, range=0..1)

# ---- group: RH_IN:SiteGenerationJson
txt = Text()

# ---- group: RH_IN:BKeyXScale
num = Number(bkeyxscale)

# ---- group: RH_IN:BKeyYScale
num_2 = Number(bkeyyscale)

# ---- group: RH_IN:GridAngle
num_3 = Number(Slider(50, range=0..180))

# ---- group: RH_IN:ParcelStoreyScale
num_4 = Number(parcelstoreyscale)

# ---- group: RH_IN:GridSpacing
num_5 = Number(Slider(25, range=10..30))

# ----
python = GhPythonScript(jsonstring=txt)  # -> out, Keys, ParcelBoundaries, ParcelEdgeCategories, ParcelBlockKeySelection, ParcelGPR
# ---------- python: Python ----------
__author__ = "Admin"
__version__ = "2023.03.07"

import rhinoscriptsyntax as rs
import ghpythonlib.treehelpers as th
import ghpythonlib.components as gh
import json

ParcelBoundaries = []
ParcelEdgeCategories = []
ParcelBlockKeySelection = []
ParcelGPR = []
jsonobj = json.loads(jsonstring)
Keys = []

for i in range(len(jsonobj.keys())):
    key = jsonobj.keys()[i]
    Keys.append(key)
    value = jsonobj[key]
    
    ParcelBoundaries.append([gh.PolyLine([gh.ConstructPoint(float(coords[0]),float(coords[1]),float(coords[2])) for coords in value['ParcelCoordinates']],True)])
    ParcelEdgeCategories.append([int(v) for v in value['EdgeCategory']])
    ParcelBlockKeySelection.append([int(v) for v in value['BKeySelection']])
    ParcelGPR.append([value['GPR']])


ParcelBoundaries = th.list_to_tree(ParcelBoundaries)
ParcelEdgeCategories = th.list_to_tree(ParcelEdgeCategories)
ParcelBlockKeySelection = th.list_to_tree(ParcelBlockKeySelection)
ParcelGPR = th.list_to_tree(ParcelGPR)
# ---------- end python ----------
cluster = Cluster(parcelblockkeyselection=python.ParcelBlockKeySelection, bkeyxscale=num, bkeyyscale=num_2)
python_2 = GhPythonScript(ParcelBoundary=python.ParcelBoundaries, GridRotation=num_3, GridSize=num_5)  # -> out, SortedGridLines, SortedGridPlanes; inputs ParcelBoundary: tree of Curve
# ---------- python_2: Python ----------
__author__ = "Admin"
__version__ = "2022.09.07"

import rhinoscriptsyntax as rs
import ghpythonlib.components as gh
import ghpythonlib.treehelpers as th
import Rhino

SortedGridPlanes = []
SortedGridLines = []

for path in ParcelBoundary.Paths:
    parcelBoundary = ParcelBoundary.Branch(path)[0]
    gridRotation = GridRotation
    gridSize = GridSize

    # create grid of points within boundary
    rotatedPlane = gh.RotatePlane(gh.XYPlane(gh.ConstructPoint(0,0,0)),gridRotation)
    rotatedBox = gh.BoundingBox(parcelBoundary,rotatedPlane)
    cornerPoint = gh.BoxCorners(rotatedBox)[0]
    vecX = gh.DeconstructPlane(rotatedPlane)[1]
    vecY = gh.DeconstructPlane(rotatedPlane)[2]
    extX = int(gh.DeconstructBox(rotatedBox)[1][0].Length / gridSize)+1
    extY = int(gh.DeconstructBox(rotatedBox)[2][0].Length / gridSize)+1
    gridPoints = gh.Square(gh.ConstructPlane(cornerPoint,vecX,vecY),gridSize,extX,extY)[1]
    gridPoints = [pt for pt in gridPoints if gh.PointInCurve(pt, parcelBoundary)[0] == 2]
    
    # create grid of planes facing closest edge
    CCP = [gh.CurveClosestPoint(gp, parcelBoundary) for gp in gridPoints]
    closestDistances = [s[2] for s in CCP]
    closestPoints = [s[0] for s in CCP]
    planeY = [gh.Vector2Pt(gridPoints[i],closestPoints[i],False)[0] for i in range(len(gridPoints))]
    planeX = [gh.CrossProduct(pY,gh.UnitZ(1),True)[0] for pY in planeY]
    gridPlanes = [gh.ConstructPlane(gridPoints[i],planeX[i],planeY[i]) for i in range(len(gridPoints))]
    
    # sort grid of planes by distance to edge
    distances = [gh.VectorLength(vec) for vec in planeY]
    gridPlanes = [x for _, x in sorted(zip(distances, gridPlanes))]
    
    # append to tree
    SortedGridPlanes.append(gridPlanes)
    SortedGridLines.append([gh.LineSDL(gridPoints[i],planeY[i],distances[i]) for i in range(len(gridPoints))])

    
SortedGridPlanes = th.list_to_tree(SortedGridPlanes)
SortedGridLines = th.list_to_tree(SortedGridLines)
# ---------- end python_2 ----------
siteaccess = GhPythonScript(ParcelBoundary=python.ParcelBoundaries, ParcelEdgeCategory=python.ParcelEdgeCategories)  # -> out, SiteAccess, SiteAccessPlane; inputs ParcelBoundary: tree of Curve, ParcelEdgeCategory: tree
# ---------- siteaccess: Python ----------
__author__ = "Anna Yenardi"
__version__ = "2022.05.19"

import rhinoscriptsyntax as rs
import ghpythonlib.components as gh
import ghpythonlib.treehelpers as th
import math

def GetSegmentForAccess(boundary, categories):

    segments = gh.Explode(boundary,True)[0]
    
    weakestCategory = max([c for c in categories if c != 6])
    LongestSegmentIndexInWeakestCategory = sorted([(gh.Length(segments[i]),i) for i,(category,segment) in enumerate(zip(categories,segments)) if category == weakestCategory])[-1][1]
    return LongestSegmentIndexInWeakestCategory
 

def GenerateSiteAccess(boundary, accessIndex, accessLength, accessWidth):
    
    segments = gh.Explode(boundary,True)[0]
    accessPt = gh.CurveMiddle(segments[accessIndex])
    
    # get inward perpendicular vector
    accessAlong = gh.Vector2Pt(gh.EndPoints(segments[accessIndex])[0],gh.EndPoints(segments[accessIndex])[1], True)[0]
    accessPerp = gh.CrossProduct(accessAlong,gh.UnitZ(1),True)[0]
    accessCenter = gh.Vector2Pt(accessPt,gh.Area(boundary)[1],True)[0]
    
    # check for directionality
    if gh.DotProduct(accessPerp,accessCenter,True) < 0:
        accessPerp *= -1
    if gh.CrossProduct(accessAlong,accessPerp,True)[0][2] < 0:
        accessAlong *= -1
    accessPlane = gh.ConstructPlane(accessPt,accessAlong,accessPerp)
    rectPlane = gh.ConstructPlane(gh.Move(accessPt,gh.Amplitude(accessAlong,-accessWidth/2))[0],accessAlong,accessPerp)
    rectGeo = gh.Rectangle(rectPlane,accessWidth,accessLength,0)[0]
    circleGeo = gh.CircleCNR(gh.Move(accessPt,gh.Amplitude(accessPerp,accessLength))[0],gh.UnitZ(1),accessWidth/2)
    accessRegion = gh.RegionUnion([rectGeo,circleGeo])
    accessRegion = gh.CurveToPolyline(accessRegion,0,80,0,5)[0]
    return accessPlane,accessRegion


accessLength = 20
accessWidth = 20

SiteAccess = []
SiteAccessPlane = []
for path in ParcelBoundary.Paths:
    parcelBoundary = ParcelBoundary.Branch(path)[0]
    parcelEdgeCategories = ParcelEdgeCategory.Branch(path)
    accessIndex = GetSegmentForAccess(parcelBoundary, parcelEdgeCategories)
    sap, sa = GenerateSiteAccess(parcelBoundary, accessIndex, accessLength, accessWidth)
    SiteAccess.append([sa])
    SiteAccessPlane.append([sap])

SiteAccess = th.list_to_tree(SiteAccess)
SiteAccessPlane = th.list_to_tree(SiteAccessPlane)
# ---------- end siteaccess ----------

python_3 = GhPythonScript(
    ParcelBoundary=python.ParcelBoundaries,
    SelectedBKey=cluster,
    ParcelStoreyScale=num_4,
    ParcelGPR=python.ParcelGPR,
    ParcelEdgeCategories=python.ParcelEdgeCategories,
    SortedGridPlanes=python_2.SortedGridPlanes,
    SiteAccess=siteaccess.SiteAccess,
    FootprintOffsetX="5",
    FootprintOffsetY="15")  # -> out, BuildingFootprint, BuildingOffset, BuildingStoreys, ParcelOffset, AllOffsetsComputed; inputs ParcelBoundary: tree of Curve, SelectedBKey: tree of Curve, ParcelGPR: tree, ParcelEdgeCategories: tree of Int32, SortedGridPlanes: tree of Plane, SiteAccess: tree of Curve
# ---------- python_3: Python ----------
import rhinoscriptsyntax as rs
import ghpythonlib.treehelpers as th
import ghpythonlib.components as gh
import Rhino
import json
import math

def ProcessFootPrint(object):
    box = gh.BoundingBox(object,gh.XYPlane(gh.ConstructPoint(0,0,0)))
    xdom = gh.DeconstructBox(box).x[0]
    ydom = gh.DeconstructBox(box).y[0]
    bBox = gh.PolyLine([gh.ConstructPoint(xdom[0], ydom[0], 0), gh.ConstructPoint(xdom[1], ydom[0], 0), gh.ConstructPoint(xdom[1], ydom[1], 0), gh.ConstructPoint(xdom[0], ydom[1], 0)], True)
    return [max(xdom[1]-xdom[0],ydom[1]-ydom[0]), bBox]

def GetMaxAllowedStoreys(GPR,blockLength):
    if blockLength > 130:
        maxA = 8
    elif blockLength > 90:
        maxA = 12
    elif blockLength > 75:
        maxA = 18
    elif blockLength > 60:
        maxA = 24
    else:
        maxA = 80    
    
    if GPR <= 1.4:
        maxB = 5
    elif GPR <= 1.6:
        maxB = 12
    elif GPR <= 2.1:
        maxB = 24
    elif GPR <= 2.8:
        maxB = 36
    else:
        maxB = 50
    return min(maxA, maxB)

def OffsetList(lst):
  return lst[1:] + lst[:1]

def ReorderSegments(segment,category, indicies):
    mysegment = segment
    mycategory = category
    myindicies = indicies
    count = 0
    while True:
        count += 1
        if mycategory[0] == mycategory[-1]:
            mysegment = OffsetList(mysegment)
            mycategory = OffsetList(mycategory)
            myindicies = OffsetList(myindicies)
        else:
            break
        if count > len(category):
            break
    return mysegment,mycategory,myindicies

def GroupEdgeIndices(crv):
    count=0
    vertices=rs.PolylineVertices(crv)
    vertices.pop()
    edgeindices=[]
    for i in range(len(vertices)):
        if i==0:
            vector1=rs.VectorCreate(vertices[len(vertices)-1],vertices[0])
            vector2=rs.VectorCreate(vertices[1],vertices[0])
            
        elif i==len(vertices)-1:
            vector1=rs.VectorCreate(vertices[i-1],vertices[len(vertices)-1])
            vector2=rs.VectorCreate(vertices[0],vertices[len(vertices)-1])
            
        else: 
    
            vector1=rs.VectorCreate(vertices[i-1],vertices[i])
            vector2=rs.VectorCreate(vertices[i+1],vertices[i])
            
        angle=rs.VectorAngle(vector1,vector2)
        if rs.VectorCrossProduct(vector1,vector2).Z>0:
            angle=360-angle

        if angle<135 or angle>225:
            count+=1

        edgeindices.append(count)
            
        if edgeindices[0]==1:
            for i in range(len(edgeindices)):
                edgeindices[i]=edgeindices[i]-1
        message = None
        return list(edgeindices)

def GetSimplifedSegments(segments,categories):
    
    finalSeg = []
    finalCat = []
    
    currSeg = [segments[0]]
    currCat = categories[0]
    for i,(segment,category) in enumerate(zip(segments[1:],categories[1:])):
        isLast = i == len(segments[1:])-1

        if category == currCat and isLast:
            currSeg.append(segment)
            finalSeg.append(gh.JoinCurves(currSeg,False))
            finalCat.append(category)
        
        elif category == currCat and not isLast:
            currSeg.append(segment)
            
        elif category != currCat and not isLast:
            finalSeg.append(gh.JoinCurves(currSeg,False))
            finalCat.append(currCat)
            currSeg = [segment]
            currCat = category
        
        elif category != currCat and isLast:
            finalSeg.append(gh.JoinCurves(currSeg,False))
            finalCat.append(currCat)
            finalSeg.append(segment)
            finalCat.append(category)
    
    finalSeg = [RemoveControlPointsWithinTolerance(s,1) for s in finalSeg]
    
    return finalSeg, finalCat

def OffsetCategoryToDistances(edgeCategory,maxStorey):
    ans = []
    
    # SETBACK 1: Setback according to height of blocks (parametric): CommonBoundarySetback
    setbacks = [0,0,3,3.4,3.8,4.7,5.5,6.4,7.2,8,8.7,9,9.2,9.5,9.8,10.1,10.3,10.6,10.8,11.1,11.3,11.6,11.8,12.1,12.4,12.7,12.9,13.2,13.4,13.7,14,14.2,14.5,14.7,15,15.2]
    if maxStorey < 36:
        CommonBoundarySetback = setbacks[maxStorey]
    else:
        CommonBoundarySetback = 15.5
    # SETBACK 2: Setback according to type of roads (static): RoadCategorySetback
    for c in edgeCategory:
        if c == 3:
            RoadCategorySetback = 2 + 10.2 + 3 + 2 + 2.4 + 2.0
        if c == 4:
            RoadCategorySetback = 0.6 + 7 + 1.9 + 2.0 + 2.4
        if c == 5:
            RoadCategorySetback = 5 + 2.5 + 1.8
        else:
            RoadCategorySetback = 5 + 2.5 + 1.8
        
        # USE MORE STRINGENT SETBACK
        if RoadCategorySetback > CommonBoundarySetback:
            ans.append(RoadCategorySetback)
        else:
            ans.append(CommonBoundarySetback)
    return [float(a) for a in ans]

def RemoveControlPointsWithinTolerance(polyline,t):
    
    controlpoints = gh.ControlPoints(polyline)[0]
    newcontrolpoints = [controlpoints[0]]
    for cp in controlpoints[1:]:
        if gh.Distance(cp, newcontrolpoints[-1]) >= t:
            newcontrolpoints.append(cp)
    return gh.PolyLine(newcontrolpoints,False)
    
def OffsetSimplifiedSegments(simplifiedSegments,offsetDistances):
    
    orginalBoundary = gh.JoinCurves(simplifiedSegments,True)
    offsetSegment = []

    for i in range(len(simplifiedSegments)):
        offsetA = gh.OffsetCurve(simplifiedSegments[i],offsetDistances[i],gh.XYPlane(gh.ConstructPoint(0,0,0)),1)
        offsetB = gh.OffsetCurve(simplifiedSegments[i],-offsetDistances[i],gh.XYPlane(gh.ConstructPoint(0,0,0)),1)
        
        if type(offsetA) is not list:
            offsetA = [offsetA]
        if type(offsetB) is not list:
            offsetB = [offsetB]
        
        if all([gh.PointInCurve(gh.CurveMiddle(offset),orginalBoundary)[0] == 2 for offset in offsetA]):
            offsetSegment += offsetA
        else:
            offsetSegment += offsetB
    
    return offsetSegment

def RebuildOffsetSegments(simplfiedOffsetSegments):
    
    finalVertices = []
    nSegments = len(simplfiedOffsetSegments)
    
    if nSegments==1:
        return simplfiedOffsetSegments[0]
    
    if nSegments == 2:
        
        currSeg = simplfiedOffsetSegments[0]
        
        nextSeg = simplfiedOffsetSegments[1]
        icd, tc, td = gh.CurveXCurve(currSeg,nextSeg)
        if icd != None and len(icd)>0:
            finalVertices += gh.ControlPoints(gh.Shatter(currSeg,tc)[1])[0]
            finalVertices += gh.ControlPoints(gh.Shatter(nextSeg,td)[1])[0]
        else:
            finalVertices += gh.ControlPoints(currSeg)[0]
            finalVertices += gh.ControlPoints(currSeg)[0]
            
        
    else:
        for i in range(nSegments):
    
            prevSeg = simplfiedOffsetSegments[i-1]
            currSeg = simplfiedOffsetSegments[i]
            nextSeg = simplfiedOffsetSegments[(i+1)%nSegments]

            prevSeg = gh.ExtendCurve(gh.RebuildCurve(prevSeg,1,100,True),0,20,20)
            currSeg = gh.ExtendCurve(gh.RebuildCurve(currSeg,1,100,True),0,20,20)
            nextSeg = gh.ExtendCurve(gh.RebuildCurve(nextSeg,1,100,True),0,20,20)
            
            iab, ta, tb = gh.CurveXCurve(prevSeg,currSeg)
            icd, tc, td = gh.CurveXCurve(currSeg,nextSeg)
            
            
            if type(iab) is list:
                iab, ta, tb = iab[0], ta[0], tb[0]
            if type(icd) is list:
                icd, tc, td = icd[0], tc[0], td[0]
            
            # if intersect with next segment, cut short, take first segment
            # if intersect with previous segment, cut short, take second segment
            if icd == None and iab != None:
                finalVertices += gh.ControlPoints(gh.Shatter(currSeg,tb)[1])[0]
            
            if icd and iab == None:
                finalVertices += gh.ControlPoints(gh.Shatter(currSeg,tc)[0])[0]
            
            if icd and iab:
                finalVertices += gh.ControlPoints(gh.Shatter(currSeg,[tb,tc])[1])[0]
            
            if iab and icd == None:
                finalVertices += gh.ControlPoints(gh.Shatter(currSeg,tc)[1])[0]
            
    #remove nearby points
    finalfinalVertices = []
    for i in range(len(finalVertices)):
        if gh.Distance(finalVertices[i],finalVertices[i-1]) > 0.5:
            finalfinalVertices.append(finalVertices[i])
    
    
    return gh.PolyLine(finalfinalVertices,True)

def GetSolutionByScaleParameter(scale,nsol):
    index = 0
    count = 0
    if scale == 0:
        return 0
    while True:
        if count < scale and scale <= count + (1/nsol):
            return index
        else:
            index += 1
            count += 1/nsol

BuildingFootprint = []
BuildingOffset = []
BuildingStoreys = []
ParcelOffset = []
AllOffsetsComputed = []
a = []
for path in list(ParcelBoundary.Paths):
    messages = []
    print(path)
    parcelBoundary = ParcelBoundary.Branch(path)[0]
    selectedBKey = SelectedBKey.Branch(path)[0]
    parcelStoreyScale = ParcelStoreyScale
    parcelGPR = ParcelGPR.Branch(path)[0]
    parcelEdgeCategory = list(ParcelEdgeCategories.Branch(path))
    sortedGridPlanes = SortedGridPlanes.Branch(path)
    siteAccess = SiteAccess.Branch(path)[0]
    
    # methods to simplify the boundary for more uniform offseting

    parcelSegments = gh.Explode(parcelBoundary,True)[0]
    simplifyIndexes = GroupEdgeIndices(parcelBoundary)
    parcelSegments, parcelEdgeCategory, simplifyIndexes = ReorderSegments(parcelSegments,parcelEdgeCategory, simplifyIndexes)
    simplifiedSegments, simplifiedCategories = GetSimplifedSegments(parcelSegments,parcelEdgeCategory)
    for s in simplifiedSegments:
        a.append(s)
    # Precompute some information
    bkeyArea = gh.Area(selectedBKey)[0]
    siteArea = gh.Area(parcelBoundary)[0]
    processedFootPrint = ProcessFootPrint(selectedBKey)
    targetTotalStoreys = int(math.floor(parcelGPR * siteArea / bkeyArea))
    maxStoreys = GetMaxAllowedStoreys(parcelGPR,processedFootPrint[0])
    maxBlockCount = int(math.floor(0.5 * siteArea * parcelGPR / bkeyArea))
    messages.append('Parcel {0}, GPR {1}, requires {2} floors, at a max of {3} floors per block'.format(path,parcelGPR,targetTotalStoreys,maxStoreys))
    
    numBlock = int(math.ceil(targetTotalStoreys/maxStoreys))
    successfulSolutions = []

    while True:
        
        remainder = targetTotalStoreys%(targetTotalStoreys//numBlock)
        additionalStorys = [1]*remainder + [0]*(numBlock-remainder)
        blockStorys = [sum(z) for z in zip([targetTotalStoreys//numBlock]*numBlock,additionalStorys)]
        
        offsetDistances = OffsetCategoryToDistances(simplifiedCategories, max(blockStorys))
        offsetSegment = OffsetSimplifiedSegments(simplifiedSegments,offsetDistances)
        parcelSetback = RebuildOffsetSegments(offsetSegment)
        orientedFootprint = []
        orientedFootprintOffset = []
        obstacles = [parcelSetback,siteAccess]
        
        AllOffsetsComputed += offsetSegment
        
        for plane in sortedGridPlanes:
            
            orientedBKey = gh.Orient(selectedBKey,gh.XYPlane(gh.ConstructPoint(0,0,0)),plane)[0]
            boundingBox = gh.BoundingBox(orientedBKey,plane)[0]
            
            boundingBox.X = Rhino.Geometry.Interval(boundingBox.X.Min - FootprintOffsetX, boundingBox.X.Max + FootprintOffsetX)
            boundingBox.Y = Rhino.Geometry.Interval(boundingBox.Y.Min - FootprintOffsetY, boundingBox.Y.Max + FootprintOffsetY)
            boundingBox = gh.JoinCurves(gh.BrepEdges(boundingBox)[0],False)

            if gh.PointInCurve(plane.Origin,parcelSetback)[0]==2:
                if gh.CollisionOneXMany(orientedBKey,obstacles)[0] == False:
                    
                    orientedFootprint.append(orientedBKey)
                    orientedFootprintOffset.append(boundingBox)
                    obstacles.append(boundingBox)
            
            if len(orientedFootprint) == numBlock:
                break
        
        if len(orientedFootprint) == numBlock:
            messages.append('Parcel {0}, oriented {1} blocks with {2} floors'.format(path,numBlock,blockStorys))
            successfulSolutions.append({
                'orientedFootprint':orientedFootprint,
                'orientedFootprintOffset':orientedFootprintOffset,
                'parcelSetback':[parcelSetback],
                'blockStorys':blockStorys,
            })
            numBlock += 1
        
        else:
            messages.append('Parcel {0}, failed to orient {1} blocks'.format(path,numBlock))
            break
    
    if len(successfulSolutions)!=0:
        solutionIndex = GetSolutionByScaleParameter(parcelStoreyScale,len(successfulSolutions))
        BuildingFootprint.append(successfulSolutions[solutionIndex]['orientedFootprint'])
        BuildingOffset.append(successfulSolutions[solutionIndex]['orientedFootprintOffset'])
        BuildingStoreys.append(successfulSolutions[solutionIndex]['blockStorys'])
        ParcelOffset.append(successfulSolutions[solutionIndex]['parcelSetback'])
    else:
        BuildingFootprint.append([])
        BuildingOffset.append([])
        BuildingStoreys.append([])
        ParcelOffset.append([])
        
        for m in messages:
            print(m)


BuildingFootprint = th.list_to_tree(BuildingFootprint)
BuildingOffset = th.list_to_tree(BuildingOffset)
BuildingStoreys = th.list_to_tree(BuildingStoreys)
ParcelOffset = th.list_to_tree(ParcelOffset)
# ---------- end python_3 ----------
python_4 = GhPythonScript(ParcelOffset=python_3.ParcelOffset, SiteAccess=siteaccess.SiteAccess)  # -> out, SetbackCurve; inputs ParcelOffset: tree of Curve, SiteAccess: tree of Curve
# ---------- python_4: Python ----------
__author__ = "Admin"
__version__ = "2023.03.29"

import rhinoscriptsyntax as rs
import ghpythonlib.components as gh
import ghpythonlib.treehelpers as th

SetbackCurve = []

for path in ParcelOffset.Paths:
    
    if ParcelOffset.Branch(path):
        setbackSurface = gh.BoundarySurfaces(gh.RegionDifference(ParcelOffset.Branch(path)[0],SiteAccess.Branch(path)[0]))
        SetbackCurve.append([setbackSurface])
    else:
        SetbackCurve.append([])

SetbackCurve = th.list_to_tree(SetbackCurve)
# ---------- end python_4 ----------
smooth = SettingsQuality()
mesh = MeshBrep(Brep=python_4.SetbackCurve, Settings=smooth)
python_5 = GhPythonScript(
    Keys=python.Keys,
    BuildingFootprint=python_3.BuildingFootprint,
    BuildingOffset=python_3.BuildingOffset,
    BuildingStoreys=python_3.BuildingStoreys,
    ParcelOffset=python_3.ParcelOffset,
    SiteAccess=siteaccess.SiteAccess,
    SetbackCurve=python_4.SetbackCurve,
    SetbackMesh=mesh)  # -> out, flatten(jsonstring); inputs Keys: list, BuildingFootprint: tree of Curve, BuildingOffset: tree of Curve, BuildingStoreys: tree of Int32, ParcelOffset: tree of Curve, SiteAccess: tree of Curve, SetbackCurve: tree of Curve, SetbackMesh: tree of Mesh
# ---------- python_5: Python ----------
__author__ = "Admin"
__version__ = "2023.03.08"

import rhinoscriptsyntax as rs
import ghpythonlib.components as gh
import json
import Rhino
jsonobj = {}

options = Rhino.FileIO.DracoCompressionOptions()
options.CompressionLevel = 5;
options.IncludeTextureCoordinates = False;
options.IncludeVertexColors = True;

for i,path in enumerate(BuildingFootprint.Paths):
    key = str(Keys[i])
    jsonobj[key] = {}
    
    jsonobj[key]['BuildingFootprint'] = [[[pt.X,pt.Y,pt.Z]for pt in gh.ControlPoints(crv)[0]] for crv in BuildingFootprint.Branch(path)]
    jsonobj[key]['BuildingOffset'] = [[[pt.X,pt.Y,pt.Z]for pt in gh.ControlPoints(crv)[0]] for crv in BuildingOffset.Branch(path)]
    jsonobj[key]['BuildingStoreys'] = list(BuildingStoreys.Branch(path))
    jsonobj[key]['ParcelOffset'] = [[[pt.X,pt.Y,pt.Z]for pt in gh.ControlPoints(crv)[0]] for crv in ParcelOffset.Branch(path)]
    jsonobj[key]['SiteAccess'] = [[[pt.X,pt.Y,pt.Z]for pt in gh.ControlPoints(crv)[0]] for crv in SiteAccess.Branch(path)]
    jsonobj[key]['SetbackMesh'] = [0]
    jsonobj[key]['SetbackCurve'] = [[[pt.X,pt.Y,pt.Z]for pt in gh.ControlPoints(crv)[0]] for crv in SetbackCurve.Branch(path)]

jsonstring = json.dumps(jsonobj)
# ---------- end python_5 ----------

# ---- group: RH_OUT:BuildingGenerationJson
txt_2 = Text(python_5.jsonstring)

# ==== cluster Cluster
parcelblockkeyselection = ClusterInput()
bkeyxscale = ClusterInput()
bkeyyscale = ClusterInput()
bkeyxscale_2 = Number(bkeyxscale)
bkeyyscale_2 = Number(bkeyyscale)
parcelblockkeyselection_2 = Number(parcelblockkeyselection)
blockkey_collection = Curve([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])
bkeynormalized = BKeyNormalized(C=blockkey_collection)
pt = ConstructPoint(XCoordinate=bkeyxscale_2, YCoordinate=bkeyyscale_2, ZCoordinate=0)
item = ListItem(List=bkeynormalized, Index=parcelblockkeyselection_2, Wrap=True)
cp = ClosestPoint(Point=pt, Cloud=item)  # -> ClosestPoint, CPIndex, Distance
item_2 = ListItem(List=blockkey_collection, Index=cp.CPIndex, Wrap=True)
panel = Panel(item_2)
area = Area(Geometry=item_2)  # -> Area, Centroid
neg = Negative(Value=area.Centroid)
move = Move(Geometry=item_2, Motion=neg)  # -> Geometry, Transform
selectedbkey = Curve(move.Geometry)
selectedbkey_2 = ClusterOutput(selectedbkey)

# ==== cluster BKeyNormalized
C = ClusterInput()
bbox = BoundingBox(Content=C, Plane=PlaneXY(0, 0, 0))  # -> Box, Box_2
boxprop = BoxProperties(Box=bbox.Box)  # -> Center, Diagonal, Area, Volume, Degeneracy
devec = DeconstructVector(Vector=boxprop.Diagonal)  # -> XComponent, YComponent, ZComponent
bnd = Bounds(Numbers=devec.XComponent)
bnd_2 = Bounds(Numbers=devec.YComponent)
remap = RemapNumbers(Value=devec.XComponent, Source=bnd, Target=Domain(0, 1))  # -> Mapped, Clipped
remap_2 = RemapNumbers(Value=devec.YComponent, Source=bnd_2, Target=Domain(0, 1))  # -> Mapped, Clipped
pt = ConstructPoint(XCoordinate=remap.Mapped, YCoordinate=remap_2.Mapped, ZCoordinate=0)
pt_2 = ClusterOutput(pt)
