# Grasshopper definition CombinedEvaluation.ghx (Grasshopper 1.0.7)

# ---- group: RH_IN:SiteGenerationJson
txt = Text()

# ---- group: RH_IN:BuildingGenerationJson
txt_2 = Text()

# ----
python = GhPythonScript(jsonstring=txt_2)  # -> out, RefKeys, ParcelOffset, SiteAccess, BuildingOffset, BuildingFootprint, BuildingStoreys, SetbackMeshstring
# ---------- python: Python ----------
__author__ = "Admin"
__version__ = "2023.03.07"

import rhinoscriptsyntax as rs
import ghpythonlib.treehelpers as th
import ghpythonlib.components as gh
import json


jsonobj = json.loads(jsonstring)
RefKeys = []
ParcelOffset = []
SiteAccess = []
BuildingOffset = []
BuildingFootprint = []
BuildingStoreys = []
SetbackMeshstring = []


for i in range(len(jsonobj.keys())):
    key = jsonobj.keys()[i]
    RefKeys.append(key)
    value = jsonobj[key]

    ParcelOffset.append([gh.PolyLine([gh.ConstructPoint(coord[0],coord[1],coord[2]) for coord in coordset],True) for coordset in value['ParcelOffset']])
    SiteAccess.append([gh.PolyLine([gh.ConstructPoint(coord[0],coord[1],coord[2]) for coord in coordset],True) for coordset in value['SiteAccess']])
    BuildingOffset.append([gh.PolyLine([gh.ConstructPoint(coord[0],coord[1],coord[2]) for coord in coordset],True) for coordset in value['BuildingOffset']])
    BuildingFootprint.append([gh.PolyLine([gh.ConstructPoint(coord[0],coord[1],coord[2]) for coord in coordset],True) for coordset in value['BuildingFootprint']])
    BuildingStoreys.append(value['BuildingStoreys'])
    SetbackMeshstring.append(value['SetbackMesh'])

ParcelOffset = th.list_to_tree(ParcelOffset)
SiteAccess = th.list_to_tree(SiteAccess)
BuildingOffset = th.list_to_tree(BuildingOffset)
BuildingFootprint = th.list_to_tree(BuildingFootprint)
BuildingStoreys = th.list_to_tree(BuildingStoreys)
SetbackMeshstring = th.list_to_tree(SetbackMeshstring)
# ---------- end python ----------
python_2 = GhPythonScript(jsonstring=txt)  # -> out, RefKeys, ParcelBoundaries, ParcelEdgeCategories, ParcelBlockKeySelection, ParcelGPR
# ---------- python_2: Python ----------
__author__ = "Admin"
__version__ = "2023.03.07"

import rhinoscriptsyntax as rs
import ghpythonlib.treehelpers as th
import ghpythonlib.components as gh
import json

ParcelBoundaries = []
ParcelEdgeCategories = []
ParcelBlockKeySelection = []
ParcelGPR = []
jsonobj = json.loads(jsonstring)
RefKeys = []

for i in range(len(jsonobj.keys())):
    key = jsonobj.keys()[i]
    RefKeys.append(key)
    value = jsonobj[key]
    
    ParcelBoundaries.append([gh.PolyLine([gh.ConstructPoint(coords[0],coords[1],coords[2]) for coords in value['ParcelCoordinates']],True)])
    ParcelEdgeCategories.append(value['EdgeCategory'])
    ParcelBlockKeySelection.append(value['BKeySelection'])
    ParcelGPR.append([value['GPR']])


ParcelBoundaries = th.list_to_tree(ParcelBoundaries)
ParcelEdgeCategories = th.list_to_tree(ParcelEdgeCategories)
ParcelBlockKeySelection = th.list_to_tree(ParcelBlockKeySelection)
ParcelGPR = th.list_to_tree(ParcelGPR)
# ---------- end python_2 ----------
tstat = TreeStatistics(Tree=python.BuildingFootprint)  # -> Paths, Length, Count

multiplication = Multiplication(A=python.BuildingStoreys, B="3.5")
Z = UnitZ(Factor=multiplication)
srf = Surface(python.BuildingFootprint)
extr = Extrude(Base=srf, Direction=Z)

Z_2 = UnitZ(Factor="3.5")
arrlinear = LinearArray(Geometry=python.BuildingFootprint, Direction=Z_2, Count=python.BuildingStoreys)  # -> UnitFootprint3D, Transform

compute_cv = GhPythonScript(X=tstat.Length)  # -> G; inputs X: list of Int32
# ---------- compute_cv: Python ----------
__author__ = "Admin"
__version__ = "2023.03.09"

import rhinoscriptsyntax as rs

G = 0
for x in X:
    if x == 0:
        G += 1
# ---------- end compute_cv ----------
ew_aspect = EWAspect(brep=extr)  # -> R, colored_mesh
viewobstruction = ViewObstruction(unitfootprint=arrlinear.UnitFootprint3D)  # -> viewobstruction_per_parcel_2, B
ma = MassAddition(Input=flatten(viewobstruction.viewobstruction_per_parcel_2))  # -> Result, PartialResults
avr = Average(Input=flatten(ew_aspect.R))
entwine = Entwine(Branch00=flatten(ew_aspect.colored_mesh), Branch01=flatten(viewobstruction.B), FlattenInputs=True)  # -> simplify(Result)
merge = Merge(Data1=avr, Data2=ma.Result)
fkeys = Panel("""MeanEWAspectRatio
TotalViewObstruction""")
python_3 = GhPythonScript(FKeys=fkeys, Scores=merge, Mesh=entwine, ConstraintViolation=compute_cv, SetbackMeshstring=python.SetbackMeshstring)  # -> out, flatten(jsonstring); inputs FKeys: list, Scores: list, Mesh: tree of Mesh, SetbackMeshstring: tree
# ---------- python_3: Python ----------
__author__ = "Admin"
__version__ = "2023.03.09"

import rhinoscriptsyntax as rs
import ghpythonlib.components as gh
import Rhino
import json
import ghpythonlib.treehelpers as th

def SerializeColor(color):
    return '#%02x%02x%02x' % (color.R,color.G,color.B)
    
options = Rhino.FileIO.DracoCompressionOptions()
options.CompressionLevel = 5;
options.IncludeTextureCoordinates = False;
options.IncludeVertexColors = True;

jsonobj = {}
jsonobj['ConstraintViolation'] = ConstraintViolation
jsonobj['Objectives'] = {}

for i in range(len(FKeys)):
    jsonobj['Objectives'][FKeys[i]] = {}
    
    score = Scores[i]
    if score == None:
        score = 99999
    jsonobj['Objectives'][FKeys[i]]['score']=score
    
    jsonobj['Objectives'][FKeys[i]]['mesh'] = {}
    jsonobj['Objectives'][FKeys[i]]['mesh']['meshstring'] = [Rhino.FileIO.DracoCompression.Compress(uniquemesh,options).ToBase64String() for uniquemesh in Mesh.Branch(i)]
    jsonobj['Objectives'][FKeys[i]]['mesh']['color'] = [SerializeColor(uniquemesh.VertexColors[0]) for uniquemesh in Mesh.Branch(i)]

jsonobj['SetbackMesh'] = [ms for msl in th.tree_to_list(SetbackMeshstring) for ms in msl]

jsonstring = json.dumps(jsonobj)


def printInnards(obj):
    
    if type(obj) == dict:
        
        for key,value in obj.items():
            
            if type(value) == dict:
                printInnards(value)
        
            elif type(value) == list:
                print(key,'length: ', len(value))
            
            else:
                print(key,value)

printInnards(jsonobj)
# ---------- end python_3 ----------

# ---- group: RH_OUT:CombinedEvaluationJson
txt_3 = Text(flatten(python_3.jsonstring))

# ==== cluster ViewObstruction
unitfootprint = ClusterInput()
unitfootprint_2 = Curve(unitfootprint)
area = Area(Geometry=unitfootprint_2)  # -> Area, Centroid
python = GhPythonScript(UnitCentroids=area.Centroid, ObstructionDist="70")  # -> out, ObstructionScore, ObstructionLines; inputs UnitCentroids: tree of Point3d
# ---------- python: Python ----------
__author__ = "Admin"
__version__ = "2023.03.30"

import rhinoscriptsyntax as rs
import ghpythonlib.components as gh

from Grasshopper.Kernel.Data import GH_Path
from Grasshopper import DataTree

def GetUnitViewObstruction(buildingIndex,footprintStorey):
    
    refCentroid = UnitCentroids.Branch(UnitCentroids.Paths[buildingIndex])[footprintStorey]
    checkCentroids = [UnitCentroids.Branch(path)[footprintStorey] for path in UnitCentroids.Paths if len(UnitCentroids.Branch(path)) > footprintStorey]
    checkDistances = [gh.Distance(refCentroid,checkCentroid) for checkCentroid in checkCentroids]
    
    unitViewObstructed = [d < ObstructionDist and d > 0 for d in checkDistances]
    unitViewObstructionScore = sum(unitViewObstructed)
    
    unitViewObstuctedLines = [gh.Line(refCentroid,checkCentroids[i]) for i,b in enumerate(unitViewObstructed) if b]
    return unitViewObstructionScore,unitViewObstuctedLines

scoreTree = DataTree[object]()
geometryTree = DataTree[object]()

buildingIndex = 7
footprintStorey = 1



ans = []
a = []
for buildingIndex in range(len(UnitCentroids.Paths)):
    buildingPath = UnitCentroids.Paths[buildingIndex]
    buildingNoStoreys = len(UnitCentroids.Branch(buildingPath))
    
    buildingScores = []
    buildingLines = []
    
    for footprintStorey in range(buildingNoStoreys):
        score,lines = GetUnitViewObstruction(buildingIndex,footprintStorey)
        refCentroid = UnitCentroids.Branch(UnitCentroids.Paths[buildingIndex])[footprintStorey]
        
        buildingScores.append(score)
        buildingLines += lines
        
    scoreTree.AddRange(buildingScores, buildingPath)
    geometryTree.AddRange(buildingLines, buildingPath)


ObstructionScore = scoreTree
ObstructionLines = geometryTree
# ---------- end python ----------
jagged = SettingsSpeed()
mesh = MeshBrep(Brep=unitfootprint_2, Settings=jagged)
crv = Curve(python.ObstructionLines)
gradient = Gradient(
    LowerLimit="0",
    UpperLimit="3",
    Parameter=flatten(python.ObstructionScore),
    stops=[0: RGB(0, 128, 0), 0.5: RGB(255, 255, 0), 1: RGB(255, 0, 0)])
python_2 = GhPythonScript(FlatMesh=flatten(mesh), FlatColor=flatten(gradient))  # -> out, GroupMesh, GroupColor; inputs FlatMesh: list of Mesh, FlatColor: list
# ---------- python_2: Python ----------
__author__ = "Admin"
__version__ = "2023.03.29"

import rhinoscriptsyntax as rs
import ghpythonlib.components as gh

GroupColor = []
GroupMesh = {}
for color in FlatColor:
    if color not in GroupColor:
        GroupColor.append(color)
        GroupMesh[str(color)] = []



for mesh,color in zip(FlatMesh,FlatColor):
    GroupMesh[str(color)].append(mesh)
GroupMesh = [gh.MeshJoin(value) for key,value in GroupMesh.items()]
# ---------- end python_2 ----------
viewobstruction_per_parcel = Number(python.ObstructionScore)
viewobstruction_per_parcel_2 = ClusterOutput(viewobstruction_per_parcel)
python_3 = GhPythonScript(ObstructionLines=python.ObstructionLines)  # -> out, ObstructionMesh; inputs ObstructionLines: list of Curve
# ---------- python_3: Python ----------
__author__ = "Admin"
__version__ = "2023.04.03"

import rhinoscriptsyntax as rs
import ghpythonlib.components as gh
import Rhino

if ObstructionLines:
    ObstructionMesh = []
    for line in ObstructionLines:
    
        pa, pb = gh.EndPoints(line)
        pd, pc = gh.EndPoints(gh.Move(line,gh.VectorXYZ(0,0,3.5)[0])[0])
        
        ObstructionMesh.append(gh.ConstructMesh([pa,pb,pc,pd],Rhino.Geometry.MeshFace(0,1,2,3)))
else:
    ObstructionMesh = None
# ---------- end python_3 ----------
mcol = MeshColours(Mesh=graft(python_2.GroupMesh), Colours=graft(python_2.GroupColor))
mjoin = MeshJoin(Meshes=flatten(python_3.ObstructionMesh))
trim = TrimTree(Tree=mcol, Depth=1)
mcol_2 = MeshColours(Mesh=mjoin, Colours=ColourSwatch(SwatchColor=RGBA(168, 168, 168, 103)))
merge = Merge(Data1=trim)
null = NullItem(Item=merge)  # -> NullFlags, InvalidFlags, Description
dispatch = Dispatch(List=merge, DispatchPattern=null.NullFlags)  # -> ListA, ListB
B = ClusterOutput(dispatch.ListB)

# ==== cluster EWAspect
brep = ClusterInput()
brep_2 = Brep(brep)
bbox = BoundingBox(Content=brep_2, Plane=PlaneXY(0, 0, 0))  # -> Box, Box_2
smooth = SettingsQuality()
trim = TrimTree(Tree=bbox.Box, Depth=1)
boxprop = BoxProperties(Box=trim)  # -> Center, unitize(Diagonal), Area, Volume, Degeneracy
mesh = MeshBrep(Brep=brep_2, Settings=smooth)  # -> graft(Mesh)
devec = DeconstructVector(Vector=boxprop.Diagonal)  # -> XComponent, YComponent, ZComponent
division = Division(A=devec.YComponent, B=devec.XComponent)
gradient = Gradient(LowerLimit=0, UpperLimit="2", Parameter=division, stops=[0: RGB(0, 128, 0), 0.5: RGB(255, 255, 0), 1: RGB(255, 0, 0)])
graft = GraftTree(Tree=gradient, IncludeEmptyLists=True, IncludeNullItems=True)
mcol = MeshColours(Mesh=mesh, Colours=graft)
R = ClusterOutput(division)
trim_2 = TrimTree(Tree=mcol, Depth=1)
colored_mesh = ClusterOutput(trim_2)
